vi "802.11 Host.gvi"   [LabVIEW Communications System Design Suite 2.0.1]
# Calculates the RF signal power on primary and secondary channels. Compares the RF signal power against CCA energy threshold and generated CCA indication based on energy detection.
# Latency: min 10 clock cycles
panel controls:
  "Trigger TX": bool  # A Boolean control to trigger a single TX packet.
  "Clear events": bool  # Boolean control to clear the events history from the front panel. The default register size of the events history is 10,000.
  "Primary Channel Selector": UFXP(2.0) = 1  # Numeric control to determine which subband is used as the primary channel. The PHY covers 80 MHz bandwidth, which can be divided into four subbands {0,…,3} of 20 MHz bandwidth for the non-high throughput (non-HT) signal. For wider bandwidths the subbands get combined. Visit ni.com/info and enter the Info Code 80211AppFWManual to access the LabVIEW Communications 802.11 Application Framework Manual for more information about channelization.
  "Transmit IP Address": string = "127.0.0.1"  # Destination IP address for the UDP output stream.
  "Transmit Port": u16 = 13000  # Target UDP port for UDP output stream, usually between 1,025 and 65,535.
  "Tab": i32
  "Power Level [dBm]": f64  # Output power level considering the transmission of a continuous wave (CW) signal that has full digital to analog converter (DAC) range. The high peak-to-average power ratio of OFDM means that the output power of transmitted 802.11 frames is usually 9 dB to 12 dB below the adjusted power level.
  "Primary Channel Center Frequency [Hz]": f64 = 2437000000  # It is the primary channel center frequency of the transmitter in Hz. Valid values depend on the device the station is running on.
  "TX RF Port": enum{"TX1/RF 0", "TX1/RF 1"} = "TX1/RF 0"  # The RF port used for TX (applicable only for USRP RIO devices).
  "RX RF Port": T1 = "RX2/RF 1"  # The RF port used for RX (applicable only for USRP RIO devices).
  "AGC": bool = TRUE  # If enabled, the optimum gain setting is chosen depending on the received signal power strength. The RX gain value is taken from Manual RX Gain if the AGC has been disabled.
  "Manual RX gain [dB]": f64 = 37.5  # Manual RX gain value. Applied if AGC is disabled.
  "PN Data Packet Size": i32 = 1024  # Packet size in bytes (range is limited to 4061, which is a single A-MPDU reduced by MAC overhead)
  "Subcarrier Format": "802.11 Subcarrier Format.gtype" = "20 MHz (IEEE 802.11 a)"  # Allows you to switch between IEEE 802.11 standard formats. The supported formats are the following: 802.11a with 20 MHz Bandwidth 802.11ac with 20 MHz Bandwidth 802.11ac with 40 MHz Bandwidth 802.11ac with 80 MHz Bandwidth (supported MCS up to 4)
  "Stop": bool  # Boolean control to stop the station.
  "RIO Device": string = "RIO0"  # The RIO address of the RF hardware device.
  "Enable Station": bool
  "reset TX staistics": bool  # A Boolean control to reset all counters of MAC TX Statistics cluster.
  "reset RX staistics": bool  # A Boolean control to reset all counters of MAC RX Statistics cluster.
  "PN Packets per Second": u32 = 1000  # Average number of packets to transmit per second (limited to 10,000. The achievable throughput might be less depending on the configuration of the station).
  "Backoff": i32 = -1  # Backoff value that is applied before a frame is transmitted. The backoff is counted in number of slots of 9 µs duration. Based on the backoff value, the backoff counting for the Backoff procedure could be fixed or random: If the backoff value is larger than or equal zero, a fixed backoff is used. If the backoff value is negative, a random backoff counting is used.
  "All": bool  # Boolean control to enable the events tracking of the above FPGA events.
  "None": bool  # Boolean control to disable the events tracking of the above FPGA events.
  "CCA Energy Detection Threshold [dBm]": FXP(10.3) = -50  # If the energy of the received signal is above the threshold, the station qualifies the medium as busy and interrupts its Backoff procedure, if any. Set the CCA Energy Detection Threshold [dBm] control to a value which is higher than the minimal value of the current curve in the RF Input Power graph.
  "MCS": UFXP(4.0) = 4  # Modulation and coding scheme index used to encode data frames. ACK frames are always sent with MCS 0. Be aware that not all MCS values are applicable for all subcarrier formats and the meaning of the MCS changes with the subcarrier format. The text field next to the MCS field shows the modulation scheme and coding rate for the current MCS and Subcarrier Format.
  "session": "802.11 Host Session.gtype"
  "Data Source Options": i32 = 1
    # Each tab shows the options for the corresponding data sources.
    # UDP Tab—A free UDP port to retrieve data for the transmitter is derived inherently based on the station number.
    # PN Tab - PN Data Packet Size—Packet size in bytes (range is limited to 4061, which is a single A-MPDU reduced by MAC overhead)
    # PN Tab - PN Packets per Second—Average number of packets to transmit per second (limited to 10,000. The achievable throughput might be less depending on the configuration of the station).
    # Manual Tab – Trigger TX—A Boolean control to trigger a single TX packet.
  "Data Sink Option": i32  # It has the following required configurations for the UDP data sink option: · Transmit IP Address—Destination IP address for the UDP output stream. Transmit Port—Target UDP port for UDP output stream, usually between 1,025 and 65,535.
  "Data Source": T7 = "PN Data"
    # Determines the source of MAC frames send from the host to the target.
    # Off— This method is useful to disable transmitting TX data while the TX chain is active to trigger ACK packets.
    # UDP—This method is useful for showing demos, such as when using an external video streaming application, or for using external network testing tool, such as Iperf. In this method, input data arrives at or is generated from the 802.11 station using user datagram protocol (UDP).
    # PN Data—This method sends random bits and is useful for functional tests. Packet size and rate can be easily adapted.
    # Manual—This method is useful to trigger single packets for debugging purposes.
    # External—Allow a potential external upper MAC realization or other external applications to use the MAC & PHY functionalities provided by the 802.11 Application Framework.
  "Data Sink": enum{"Off", "UDP"} = "Off"  # It has the following options: Off—Data is discarded. UDP—If enabled, received frames are forwarded to the configured UDP address and port (see below).
  "Reference Clock": string = "Internal"
    # Configures the reference for the device clocks. The reference frequency must be 10 MHz. You can choose from the following sources:
    # Internal—Uses the internal reference clock.
    # REF IN / ClkIn—The reference is taken from the REF IN port (USRP-294xR, and USRP-295XR) or the ClkIn port (NI 5791).
    # GPS—The reference is taken from the GPS module. Only applicable for the USRP-2950/2952/2953 devices.
    # PXI_CLK—The reference is taken from the PXI chassis. Only applicable for PXIe-7975/7976 targets with NI-5791 adapter modules.
  "dot11RTSThreshold": u32 = 2000
    # Semi-static parameter used by frame sequence selection to decide whether RTS|CTS is allowed or not.
    # If the PSDU length, i.e. PN Data Packet Size, is larger than dot11RTSThreshold, the {RTS | CTS | DATA | ACK} frame sequence is used.
    # If the PSDU length, i.e. PN Data Packet Size, is less than or equal to the dot11RTSThreshold, the {DATA | ACK} frame sequence is used.
    # This mechanism allows stations to be configured to initiate RTS/CTS either always, never, or only on frames longer than a specified length.
  "dot11ShortRetryLimit": u16 = 7  # Semi-static parameter—Maximum number of retries applied for short MPDU type (sequences without RTS|CTS). If the number of retry limits is reached, discards MPDUs and associated MPDU configuration and TX vector.
  "dot11LongRetryLimit": u16 = 4  # Semi-static parameter—Maximum number of retries applied for long MPDU type (sequences including RTS|CTS). If the number of retry limits is reached, discards MPDUs and associated MPDU configuration and TX vector.
  "control frame TX vector configuration": T8  # Applies the configured MCS values in TX vectors for RTS, CTS or ACK frames. The default control frame configuration of those frames is Non-HT-OFDM and 20 MHz bandwidth while the MCS can be configured from the host.
  "FPGA events to track": "802.11 Events Enable Mask.gtype"  # It has a set of Boolean controls; each control is used to enable or disable the tracking of the corresponding FPGA event. Those events are as follows: PHY TX start request PHY TX end indication PHY RX start indication PHY RX end indication PHY CCA timing indication PHY RX gain change indication DCF state indication MAC MPDU RX indication MAC MPDU TX request
  "Device MAC Address": string = "46:6F:4B:75:6D:61"  # MAC address associated with the station. The Boolean Indicator shows if the given MAC address is valid or not. The MAC address validation is done in the dynamic mode.
  "Destination MAC Address": string = "46:6F:4B:75:6D:62"  # MAC address of the destination to which packets should be sent. The Boolean indicator shows if the given MAC address is valid or not. If running in RF loopback mode, the Destination MAC Address and the Device MAC Address should be similar.
  "log file prefix": string = "events.txt"  # Name a text file to write the FPGA events data that have been read from the Event DMA FIFO. They presented above in the FPGA events to track. Each event consists of a time stamp and the event data. The text file is created locally in the project folder. Only the selected events in the FPGA events to track above will be written in the text file.
  "write to file": bool  # Boolean control to enable or disable the writing process of the selected FPGA events to the text file.
  "AGC target signal power [dBFS]": FXP(10.3) = -20  # Target RX power in digital base band used if the AGC is enabled. The optimal value depends on the peak to average power ratio (PAPR) of the received signal. Set the AGC target signal power to a value larger than that presented in the Baseband RX Power graph.
  "Station Number": u16 = 1  # Numerical control to set the station number. Each running station should have a different number. It can be up to 10. If the user would like to increase the number of running stations, the cache of MSDU Sequence Number assignment and Duplicate Detection should be increased to the required value, since the default value is 10.
  "values per second": bool  # A Boolean control to show the MAC TX Statistics and MAC RX Statistics either the accumulated values since the last reset or the values per second.
  "RF loop back demo mode": bool
  "enable channel capture": bool
  "signal transmission stop": FXP(10.3)
  "Threshold": FXP(10.3)
panel indicators:
  "Events": string
  "Baseband RX Power": f64[][]  # Graphical indication displays the baseband signal power at packet start. The numerical indicator shows the actual receiver's baseband power. When the AGC is enabled, the 802.11 Application Framework attempts to keep this value at the given AGC target signal power in Advanced tab by changing the RX gain accordingly.
  "Coerced LO frequency TX [Hz]": f64  # Actual used TX frequency on target.
  "Coerced LO frequency RX [Hz]": f64  # Actual used RX frequency on target.
  "Channel Estimation": cluster{"Element 1": i32[], "Element 2": f64[]}[]  # Graphical indication shows the amplitude and phase of the estimated channel (based on L-LTF and VHT-LTF).
  "TX Error Rates": f64[][]  # Graphical indication shows the TX packet error rate and TX block error rate. The TX packet error rate is calculated as a ratio of successful MPDU transmitted to the number of transmission tries. The TX block error rate is calculated as a ratio of successful MPDU transmitted to the total number of transmission. The most recent values are displayed on the upper right of the graph.
  "Coerced Power Level [dBm]": f64  # Power level of a continuous wave of 0 dBFS that provides for the current device settings. The average output power of 802.11 signals is approximately 10 dB below this level. Indicates the actual power level considering RF frequency and device-specific calibration values from the EEPROM.
  "RX Throughput": f64  # Graphical indication shows the data rate of successful received and decoded frames matching the Device MAC Address.
  "Applied RX Gain [dB]": f64  # A numerical indicator shows RX gain value currently applied. This value is the Manual RX Gain when the AGC is disabled, or the calculated RX gain when AGC is enabled. In both cases, the gain value is coerced by the capabilities of the device.
  "RX Throughput [bits/s]": f64  # Numerical indication shows the data rate of successful received and decoded frames matching the Device MAC Address.
  "current TX packet error rate": f64
  "RF Frequency [Hz]": f64  # The RF center frequency after the adjustment based on the Primary Channel Selector control and the operating bandwidth.
  "Station Active": bool  # Boolean indicator shows if the station RF is active after enabling the station by setting the Enable Station control to On.
  "Device Ready": bool  # Boolean indicator shows if the device is ready. If you receive an error, try one of the following: Ensure your RIO device is connected properly. Check the configuration of RIO Device. Check the station number. It should be different if more than one station is running on the same host.
  "Baseband RX Power [dBFS]": f64
  "RX Constellation": c128[]  # Graphical indication shows the constellation of RX I/Q samples of the received data field.
  "RX Power Spectrum": T2  # A snapshot of the current baseband spectrum from the RX.
  "TX Power Spectrum": T2  # A snapshot of the current baseband spectrum from the TX.
  "Data Transfer": bool  # Indicates that the packets are successfully read from the given port. Look to video streaming for more details.
  "FIFO Full": bool  # Indicates that the socket buffer of the UDP reader is small to read the given data, so packets are dropped. Increase the socket buffer size.
  "FIFO Full": bool  # Indicates that the socket buffer of the UDP sender is small to receive the payload from the RX Data direct memory access (DMA) FIFO, so packets are dropped. Increase the socket buffer size.
  "Data Transfer": bool  # Indicates that the packets are successfully read from the DMA FIFO and forwarded to the given UDP port.
  "Compensated CFO [Hz]": f64  # Carrier frequency offset detected by coarse frequency estimation unit. For FlexRIO/FlexRIO adapter module, set the reference clock to PXI_CLK or REF IN/ClkIn.
  "modulation and coding rate": string
  "Target FIFO Overflow": bool  # Boolean indicator that lights if there is an overflow in the target to host (T2H) first-in-first-out memory buffers (FIFOs). If one of the T2H FIFOs overflows, its information is no longer reliable. Those FIFOs are as follows: T2H RX Data overflow T2H Constellation overflow T2H RX Power Spectrum overflow T2H Channel Estimation overflow TX to RF FIFO overflow
  "RF Input Power": f64[][]  # Displays the current RF input power in dBm regardless of the type of incoming signal if an 802.11 packet has been detected. This indicator displays the RF input power, in dBm, currently being measured, as well as at the most recent packet start.
  "MAC RX statistics": "802.11 MAC RX Statistics.gtype"
    # Numerical indication shows the values of the following counters related to MAC RX. The presented values could be the accumulated values since the last reset or the values per second based on the status of the Boolean control values per second.
    # preamble detected (by the synchronization)
    # PHY service data units (PSDUs) received (frames with valid physical layer convergence procedure (PLCP) header, frames without format violations)
    # MPDU CRC OK (the frame check sequence (FCS) check passes)
    # RTS detected
    # CTS detected
    # Data detected
    # ACK detected
  "MAC TX statistics": "802.11 MAC TX Statistics.gtype"  # Numerical indication shows the values of the following counters related to MAC TX. The presented values could be the accumulated values since the last reset or the values per second based on the status of the Boolean control values per second. RTS Triggered CTS Triggered Data Triggered ACK Triggered
  "Averaged Retransmissions per Packet": f64  # Graphical indication shows the average number of transmission tries. The recent value is displayed on the upper right of the graph.
  "valid": bool  # Boolean indicator shows if the given Device MAC Address associated with the device station is valid.
  "valid": bool  # Boolean indicator shows if the given Destination MAC Address associated with the device station is valid.
  "Channelization": cluster{"x": f64, "y": f64}[][]  # Graphical indication shows which sub-band is used as the primary channel based on the Primary Channel Selector. The PHY covers 80 MHz bandwidth, which can be divided into four sub-bands {0,…,3} of 20 MHz bandwidth for the non-HT signal. For wider bandwidths (40 MHz or 80 MHz), the sub-bands get combined. Visit ni.com/info and enter the Info Code 80211AppFWManual to access the LabVIEW Communications 802.11 Application Framework Manual for more information about channelization.
  "Averaged Retransmissions p. Packet": f64
  "current TX block error rate": f64
  "Receive Port": u16  # Source UDP port of UDP input stream.
  "num packets source": u32  # Numerical indicator shows the number of packets that have been received from the data source (UDP, PN Data, or Manual).
  "transfer source": bool  # Boolean indicator shows that a data is receiving from the data source (the number of received packets is not zero).
  "num packets sink": u32  # Number of received packets at data sink from MAC high.
  "transfer sink": bool  # Boolean indicator shows that a data is receiving from the MAC high.
  "TX Indications Middle MAC": u32  # Numerical indicator shows the number of MAC TX Status Indications reported from MAC Middle to MAC high using the assigned UDP port located above it.
  "TX Requests to PHY": u32  # Numerical indicator shows the number of MAC MSDU TX requests written to the DMA FIFO.
  "RX Indications from PHY": u32  # : Numerical indicator shows the number of MAC MSDU RX indications read from the DMA FIFO.
  "RX Indications High MAC": u32  # Numerical indicator shows the number of MAC MSDU RX indications with valid MSDU data received at MAC high.
  "RX Indications Middle MAC": u32  # Numerical indicator shows the number of MAC MSDU RX indications that have been decoded correctly and reported to the MAC high using the assigned UDP port located above it.
  "TX Indications from PHY": u32  # Numerical indicator shows the number of MAC MSDU TX end indications read from the DMA FIFO.
  "TX Request High MAC": cluster{"Config": u32, "Payload": u32}  # Numerical indicators show the number of MAC TX Configuration and Payload request messages generated by the MAC high abstraction layer and written to the corresponding UDP port that is located under them.
  "TX Request Middle MAC": cluster{"Config": u32, "Payload": u32}  # Numerical indicators show the number of MAC TX Configuration and Payload request messages received from the MAC high abstraction layer and read from the corresponding UDP port that is located above them. Before transfer both messages to the lower layers, the given configurations are checked if they are supported or not, in addition, the MAC TX Configuration request and MAC TX Payload request are checked if they are consistence.
  "TX Confirmation Middle MAC": cluster{"Config": u32, "Payload": u32}  # Numerical indicators show the number of confirmation messages that have been generated by the MAC middle for the MAC TX Configuration and MAC TX Payload messages and written to the assigned UDP port located above them.
  "TX Indication Overflow Count": u16  # Numerical indicator shows the number of overflows that occurred during the FIFO writing by TX End indications.
  "TX Indication Overflow": bool
  "RX Indication Overflow Count": u16  # Numerical indicator shows the number of overflows that occurred during the FIFO writing by MAC MSDU RX indications.
  "RX Indication Overflow": bool
  "TX requests": u16  # Reference to the UDP socket used to send or receive the TX requests.
  "local TX confirmations": u16  # Reference to the UDP socket used to send or receive the TX confirmations.
  "local RX indications": u16  # Reference to the UDP socket used to send or receive the RX indications.
  "local TX indications": u16  # Reference to the UDP socket used to send or receive the TX indications.
  "Packets dropped count": u32  # Numerical indicator shows the number of MAC MSDU TX requests written to the DMA FIFO.
  "Packets dropped": bool
  "packets sync output": T9
  "initialized array": f64[][]
  "threshold signal": bool
types:
  T1 = enum{"RX1/RF 0", "RX2/RF 0", "RX1/RF 1", "RX2/RF 1"}
  "802.11 Subcarrier Format.gtype" = enum{"20 MHz (IEEE 802.11 a)", "20 MHz (IEEE 802.11 ac)", "40 MHz (IEEE 802.11 ac)", "80 MHz (IEEE 802.11 ac)"}
  T2 = cluster{"f0": f64, "df": f64, "magnitude": f64[]}
  T3 = cluster{"Timestamp": u32, "Transferred Bytes": u32}
  T4 = cluster{"fpga ref": any, "bus instance": u32, "instruction FIFO depth": u32, "executing on FPGA target": bool, "show error call chain": bool}
  T5 = cluster{"Actual Gain [dB]": f64, "Attenuation Table Index": i32}
  T6 = cluster{"Attenuation Table [dB]": f64[][], "Frequencies [Hz]": f64[], "IQ Imbalance Table": "niUsrpRio Config v1 Host.lvlib__IQ Imbalance.gtype"[], "Gain Table": T5[][]}
  "niInstr Register Bus v0 Host.lvlib__Register Bus Session.gtype" = Queue<"niInstr Register Bus v0 Host.lvlib__Session Data.gtype">
  "Semaphore RefNum.gtype" = i32
  "niUsrpRio Config v1 Host.lvlib__DB Queue Reference.gtype" = Queue<"niUsrpRio Config v1 Host.lvlib__Daughterboard Data.gtype">
  "niUsrpRio Config v1 Host.lvlib__niUsrpRio Session.gtype" = cluster{"FPGA Interface": any, "RIO Interface Number": u32, "Data Clock Rate": u32, "FPGA Data Clock Rate": u32, "Global Settings Register Bus": "niInstr Register Bus v0 Host.lvlib__Register Bus Session.gtype", "Radio 0 Settings Register Bus": "niInstr Register Bus v0 Host.lvlib__Register Bus Session.gtype", "Radio 1 Settings Register Bus": "niInstr Register Bus v0 Host.lvlib__Register Bus Session.gtype", "Radio Settings Bus Semaphore": "Semaphore RefNum.gtype", "DB Queues": "niUsrpRio Config v1 Host.lvlib__DB Queue Reference.gtype"[], "Characterization Data Valid?": bool, "EEPROM Header": "niUsrpRio Config v1 Host.lvlib__EEPROM Header.gtype", "Device Data Header": "niUsrpRio Config v1 Host.lvlib__EEPROM Device Data Header.gtype", "EEPROM Characterization Header": "niUsrpRio Config v1 Host.lvlib__EEPROM Characterization Header.gtype", "Characterization Data": "niUsrpRio Config v1 Host.lvlib__Characterization Data.gtype"[], "FPGA Current Version": u32, "FPGA Oldest Compatible Version": u32, "Fixed Logic Current Version": u32, "Fixed Logic Oldest Compatible Version": u32, "FPGA Radio Settings Bus Current Version": u32, "FPGA Radio Settings Bus Oldest Compatible Version": u32, "FPGA Board Config Current Version": u32, "FPGA Board Config Oldest Compatible Version": u32, "Daughterboard Clock Rate": u32}
  "802.11 Host Session.gtype" = cluster{"station number": u16, "FPGA interface": "802.11 FGPA Reference.gtype", "MAC High Requests": Queue<u8[]>, "MAC High Confirmations": Queue<u8[]>, "Triggered TX Requests": Queue<"802.11 TX Request Confirmation Reference Parameters.gtype">, "receive queue": Queue<u8[]>, "receive throughput queue": Queue<T3>, "UDP Receiver": UdpNetworkConnectionRefnum, "PN packet": u8[], "FlexRIO session": Queue<T4>, "FlexRIO TX Characterization Data": T6, "FlexRIO RX Characterization Data": T6, "USRP session": "niUsrpRio Config v1 Host.lvlib__niUsrpRio Session.gtype", "RF loop clock frequency": f64, "UDP Receiver TX Request": UdpNetworkConnectionRefnum, "UDP Receiver TX Confirmation": UdpNetworkConnectionRefnum, "UDP Receiver RX Indication": UdpNetworkConnectionRefnum, "UDP Sender": UdpNetworkConnectionRefnum, "OpaqueRefnum": "FPGA interface_3.gtype"}
  T7 = enum{"Off", "UDP", "PN Data", "Manual", "External"}
  T8 = cluster{"RTS MCS": UFXP(4.0), "CTS MCS": UFXP(4.0), "ACK MCS": UFXP(4.0)}
  "802.11 MAC RX Statistics.gtype" = cluster{"preamble detected": u32, "PSDUs received": u32, "MPDU CRC OK": u32, "RTS detected": u32, "CTS detected": u32, "Data detected": u32, "ACK detected": u32}
  "802.11 MAC TX Statistics.gtype" = cluster{"RTS triggered": u32, "CTS triggered": u32, "Data triggered": u32, "ACK triggered": u32}
  "802.11 Events Enable Mask.gtype" = cluster{"PHY TX start request": bool, "PHY TX end indication": bool, "PHY RX start indication": bool, "PHY RX end indication": bool, "PHY CCA timing indication": bool, "PHY RX gain change indication": bool, "DCF state indication": bool, "MAC MPDU RX indication": bool, "MAC MPDU TX request": bool}
  T9 = cluster{"Resync": u32, "Total sync": u32, "Last Sample": u32}
  "Log Level.gtype" = enum{"Trace", "Debug", "Info", "Warn", "Error", "Fatal"}
  "Log Configuration.gtype" = cluster{"enabled": bool, "max log level": "Log Level.gtype"}
  "802.11 TX Status.gtype" = enum{"MPDU transmitted", "MPDU discarded"}
  "802.11 MAC TX End Indication.gtype" = cluster{"TX status": "802.11 TX Status.gtype", "number of transmission tries": u16, "valid": bool}
diagram:
  sequence {
    frame 0 {
      $Events <- EmptyString
      $"Device Ready" <- FALSE
      $"Station Active" <- FALSE
      $"Enable Station" <- FALSE
      $"Target FIFO Overflow" <- FALSE
      $"RX Constellation" <- c128[] []
      $"RX Power Spectrum" <- T2 {all zero or empty}
      $"TX Power Spectrum" <- T2 {all zero or empty}
      $"Channel Estimation" <- cluster{"Element 1": i32[], "Element 2": f64[]}[] []
      $"current TX packet error rate" <- 0
      $"current TX block error rate" <- 0
      $"RX Throughput [bits/s]" <- 0
      $"Compensated CFO [Hz]" <- 0
      $"Averaged Retransmissions p. Packet" <- 0
      for (N = 51) {
        $"RX Throughput" <- NaN
        $"Averaged Retransmissions per Packet" <- NaN
      }
      Initialize Array(element=NaN, size=51, size=2) -> w1
      $"RF Input Power" <- w1
      $"Baseband RX Power" <- w1
      $"TX Error Rates" <- w1
      $"initialized array" <- w1
      $"MAC RX statistics" <- "802.11 MAC RX Statistics.gtype" {all zero or empty}
      $"MAC TX statistics" <- "802.11 MAC TX Statistics.gtype" {all zero or empty}
    }
  }
  call "Create Stop Notifier.gvi"(error in=no error) -> (error out=w2)
  call "802.11 Host Init.gvi"(device=$"RIO Device", error in=w2, reference clock=$"Reference Clock") -> (session out=w3, error out=w4)
  case (w4) {
    frame Error {
      w5 = w4
    }
    frame No Error {
      $"Device Ready" <- TRUE
      $session <- w3
      w5 = w4
    }
  }
  Property Node(instance in="Log Configuration.gtype" {all zero or empty}, "enabled"=TRUE, "max log level"="Info") -> (instance out=w6)
  call "Change Log Configuration.gvi"(notification=w6, error in=w5) -> (error out=w7)
  Obtain Queue(element data type="802.11 MAC TX End Indication.gtype" {all zero or empty}, error in=w7) -> (error out=w8, queue out=w9)
  s1 = w7  # shift register
  while {
    Wait(time to wait=10)
    # Middle MAC SAP
    case ($"Station Active") {
      frame False, Default {
        w10 = s1
      }
      frame True {
        Property Node(instance in=$session) -> ("station number"=w11, "FPGA interface"=w12, "UDP Receiver TX Request"=w13, "UDP Sender"=w14, "Triggered TX Requests"=w15, "receive throughput queue"=w16)
        Is Equal(x=$"Data Source", y="External") -> w17
        To Unsigned Byte Integer(number=w11) -> w18
        call "802.11 MAC SAP TX Request Confirmation Handler.gvi"(FPGA interface=w12, UDP connection TX request=w13, UDP send connection=w14, error in=s1, TX request confirmation reference queue in=w15, external mode=w17, instance ID=w18) -> (error out=w19, num packets to FPGA=w20, num TX Request=w21, num TX Confirmation=w22, num packets dropped=w23)
        $"TX Request Middle MAC" <- w21
        $"TX Confirmation Middle MAC" <- w22
        $"TX Requests to PHY" <- w20
        $"Packets dropped count" <- w23
        Feedback Node(input=w23) -> w24
        Is Not Equal(x=w23, y=w24) -> w25
        $"Packets dropped" <- w25
        call "802.11 Generate MAC SAP TX Status Indication.gvi"(FPGA interface=w12, TX request confirmation reference queue in=w15, instance ID=w18, error in=s1, TX status and retransmission queue=w9, external mode=w17, UDP send connection=w14) -> (num indications received=w26, error out=w27, num indications triggered=w28)
        call "802.11 Generate MAC SAP RX Indication.gvi"(FPGA interface=w12, receive throughput queue=w16, error in=s1, instance ID=w18, UDP send connection=w14, external mode=w17) -> (error out=w29, num indications received=w30, num indications triggered=w31)
        Merge Errors(w19, w27, w29) -> (error out=w10)
        $"TX Indications from PHY" <- w26
        $"TX Indications Middle MAC" <- w28
        $"RX Indications from PHY" <- w30
        $"RX Indications Middle MAC" <- w31
      }
    }
    call "Check Stop.gvi"(error in=w10) -> (error out=w32, stop=w33)
    next s1 = w32
    stop if w33
  }
  call "Stop On Error.gvi"(error in=s1) -> (error out=w34)
  s2 = w7  # shift register
  while {
    # data source and sink
    # (UDP send and receive)
    case ($"Station Active") {
      frame False, Default {
        w35 = s2
      }
      frame True {
        Property Node(instance in=$session) -> ("UDP Receiver"=w36, "MAC High Requests"=w37, "PN packet"=w38, "UDP Sender"=w39, "receive queue"=w40)
        Array Subset(array=w38, length0=$"PN Data Packet Size") -> w41
        case ($"Data Source") {
          frame "Off", "External" {
            w42 = s2
            w43 = FALSE
            w44 = FALSE
            w45 = 0
          }
          frame "UDP" {
            # UDP
            call "802.11 Receive UDP Data.gvi"(UDP receiver=w36, send queue=w37, error in=s2) -> (data transfer=w43, error out=w42, FIFO full=w44, num packets=w45)
          }
          frame "PN Data" {
            # PN data
            call "802.11 Send PN Data.gvi"(PN packets per second=$"PN Packets per Second", send queue=w37, PN data=w41, error in=s2) -> (data transfer=w43, error out=w42, FIFO full=w44, num packets=w45)
          }
          frame "Manual" {
            # Manual
            case ($"Trigger TX") {
              frame False, Default {
                w42 = s2
                w43 = $"Trigger TX"
                w44 = default
                w45 = default
              }
              frame True {
                Enqueue Element(element=w41, error in=s2, queue=w37, timeout in ms=0) -> (error out=w42, queue out=w46, timed out?=w44)
                w43 = $"Trigger TX"
                w45 = 1
              }
            }
          }
        }
        $"Data Transfer" <- w43
        $"FIFO Full" <- w44
        Is Not Equal To 0(x=w45) -> w47
        $"transfer source" <- w47
        Feedback Node(input=w48) -> w49
        Add(w45, w49) -> w48
        $"num packets source" <- w48
        Is Equal(x=$"Data Sink", y="UDP") -> w50
        call "802.11 Send UDP Data.gvi"(target port=$"Transmit Port", target IP address=$"Transmit IP Address", receive queue=w40, UDP sender=w39, enable=w50, error in=s2) -> (DNS resolve failed=w51, FIFO full=w52, error out=w53, data transfer=w54, num packets=w55)
        $"Data Transfer" <- w54
        $"FIFO Full" <- w52
        Is Not Equal To 0(x=w55) -> w56
        $"transfer sink" <- w56
        Merge Errors(w42, w53) -> (error out=w35)
        Feedback Node(input=w57) -> w58
        Add(w55, w58) -> w57
        $"num packets sink" <- w57
        case (w51) {
          frame False, Default { }
          frame True {
            $"Data Sink" <- "Off"
            w59 = "DNS resolve of Transmit IP Address failed, disabled Data Sink"
            One Button Dialog(message=w59)
          }
        }
      }
    }
    call "Check Stop.gvi"(error in=w35) -> (error out=w60, stop=w61)
    Wait(time to wait=5)
    next s2 = w60
    stop if w61
  }
  call "Stop On Error.gvi"(error in=s2) -> (error out=w62)
  s3 = w7  # shift register
  while {
    # MAC High Stub
    Is Not Equal(x=$"Data Source", y="External") -> w63
    Logical And(w63, $"Station Active") -> w64
    case (w64) {
      frame False, Default {
        w65 = s3
      }
      frame True {
        w66 = $session
        Property Node(instance in=w66) -> ("MAC High Requests"=w67)
        Flush Queue(error in=s3, queue=w67) -> (error out=w68, remaining elements=w69)
        Array Subset(array=w69, length0=200) -> w70
        s4 = w68  # shift register
        for (iteration -> i1) {
          w71 = each element of w70
          Property Node(instance in=w66) -> ("station number"=w72, "UDP Sender"=w73)
          Property Node(instance in=w71) -> ("Element 0"=w74)
          Select(s=$"RF loop back demo mode", t=$"Device MAC Address", f=$"Destination MAC Address") -> w75
          call "802.11 Prepare MAC SAP TX Request.gvi"(payload=w74, MCS=$MCS, device MAC address=$"Device MAC Address", destination MAC address=w75, error in=s4, subcarrier format=$"Subcarrier Format") -> (MSDU TX parameters=w76, PHY TX parameters=w77, MSDU TX payload=w78, error out=w79)
          To Unsigned Byte Integer(number=w72) -> w80
          call "802.11 MAC TX Request Confirm Abstraction.gvi"(MSDU TX parameters=w76, PHY TX parameters=w77, MSDU TX payload=w78, error in=w79, UDP connection ID in=w73, instance ID=w80) -> (error out=w81)
          Increment(x=i1) -> w82
          To Unsigned Long Integer(number=w82) -> w83
          Property Node(instance in=cluster{"Config": u32, "Payload": u32} {all zero or empty}, "Config"=w83, "Payload"=w83) -> (instance out=w84)
          next s4 = w81
        }
        Property Node(instance in=w66) -> ("receive queue"=w85, "UDP Receiver RX Indication"=w86, "FPGA interface"=w87)
        Property Node(instance in=w87, error in=s3) -> ("device bandwidth"=w88, error out=w89)
        s5 = w89  # shift register
        for (N = 200) {
          call "802.11 Receive MAC RX Indications.gvi"(UDP interface in=w86, error in=s5, device bandwidth=w88) -> (MSDU data=w91, MSDU data valid=w92, timeout=w93, error out=w94)
          case (w92) {
            frame False, Default {
              w95 = w94
            }
            frame True {
              Enqueue Element(element=w91, error in=w94, queue=w85, timeout in ms=-1) -> (error out=w95)
            }
          }
          call "802.11 Clear and Log MAC Middle SAP errors.gvi"(error in=w95) -> (error out=w96)
          append TRUE to w90 if w92
          next s5 = w96
          stop if w93
        }
        Merge Errors(s4, s5) -> (error out=w65)
        Feedback Node(input=w97) -> w98
        Add(w84, w98) -> w97
        $"TX Request High MAC" <- w97
        Array Size(array=w90) -> (size(s)=w99)
        To Unsigned Long Integer(number=w99) -> w100
        Feedback Node(input=w101) -> w102
        Add(w100, w102) -> w101
        $"RX Indications High MAC" <- w101
      }
    }
    call "Check Stop.gvi"(error in=w65) -> (error out=w103, stop=w104)
    Wait(time to wait=10)
    next s3 = w103
    stop if w104
  }
  call "Stop On Error.gvi"(error in=s3) -> (error out=w105)
  s6 = w7  # shift register
  s7 = string[] []  # shift register
  s8 = uninitialised  # shift register
  while (iteration -> i2) {
    Property Node(instance in=$session) -> ("FPGA interface"=w106)
    call "802.11 Prepare Constellation.gvi"(FPGA interface=w106, error in=s6, maximal number of subcarriers=4800) -> (error out=w107, data field constellation=w108, update constellation=w109)
    # update plots and indicators (slow)
    Logical And($"Station Active", w109) -> w110
    case (w110) {
      frame False { }
      frame True {
        $"RX Constellation" <- w108
      }
    }
    call "802.11 Prepare RX Power Spectrum.gvi"(FPGA interface=w106, error in=s6) -> (error out=w111, RX power spectrum=w112, update power spectrum=w113)
    call "802.11 Prepare TX Power Spectrum.gvi"(FPGA interface=w106, error in=s6) -> (error out=w114, TX power spectrum=w115, update power spectrum=w116)
    call "802.11 Prepare Channel Estimation.gvi"(FPGA interface=w106, error in=s6) -> (error out=w117, channel estimation=w118, update power spectrum=w119)
    call "802.11 Read T2H Overflows.gvi"(FPGA interface=w106, error in=s6) -> (error out=w120, TX end indication overflow count=w121, T2H RX Data overflow=w122)
    Type Cast(type="FPGA interface_3.gtype" constant, x=w106) -> w123
    call "802.11 Read Target Registers.gvi"(OpaqueRefnumLiteral=w123, error in=s6, station active=$"Station Active") -> (error out=w124, target FIFO overflow=w125, compensated CFO=w126, RF input power=w127, MAC RX statistics=w128, MAC TX statistics=w129, baseband signal power=w130, packets sync output=w131)
    w132 = 10000  # max log entries
    call "802.11 Read Event FIFO.gvi"(FPGA interface=w106, error in=s6) -> (raw events=w133, FPGA interface dup=w134, error out=w135)
    call "802.11 Log Events.gvi"(raw event data=w133, error in=w135, FPGA reference=w134, maximal number of log entries=w132) -> (error out=w136, dropped events=w137)
    call "Log Formatter.gvi"(error in=w136) -> (error out=w138, log entries=w139)
    Feedback Node(input=$"write to file") -> w140
    Is Not Equal(x=$"write to file", y=w140) -> w141
    case (w141) {
      frame False, Default {
        w142 = s8
        w143 = s6
      }
      frame True {
        case ($"write to file") {
          frame False, Default {
            Close File(error in=s6, refnum=s8) -> (error out=w143)
            w142 = default
          }
          frame True {
            Get Component Directory() -> (Path=w144)
            Get Current Time() -> (current time=w145)
            Format Date Time String(time format string (%c)="_%Y-%m-%d_%H-%M-%S", time stamp=w145) -> (date/time string=w146)
            Concatenate Strings($"log file prefix", w146, ".txt") -> w147
            Build Path(base path=w144, name or relative path=w147) -> (appended path=w148)
            # reopen file if file name changed
            Open Or Create Or Replace File(access (0:read/write)="write-only", error in=s6, file path (use dialog)=w148, operation (0:open)="replace or create") -> (error out=w143, refnum out=w142)
          }
        }
      }
    }
    case (w137) {
      frame False, Default {
        w149 = w139
      }
      frame True {
        Array Subset(array=w139, index0=1) -> w150
        Build Array[ConcatenateInputs=True]("(...)\n", w150) -> w149
      }
    }
    case ($"write to file") {
      frame False, Default {
        w151 = w142
        w152 = w143
      }
      frame True {
        Concatenate Strings(w149) -> w153
        Write To Text File(error in=w143, file (use dialog)=w142, text=w153) -> (error out=w152, refnum out=w151)
      }
    }
    Merge Errors(w107, w111, w114, w117, w120, w124, w138, w152) -> (error out=w154)
    call "Check Stop.gvi"(error in=w154) -> (error out=w155, stop=w156)
    Logical And($"Station Active", w113) -> w157
    case (w157) {
      frame False, Default { }
      frame True {
        $"RX Power Spectrum" <- w112
      }
    }
    Logical And($"Station Active", w116) -> w158
    case (w158) {
      frame False, Default { }
      frame True {
        $"TX Power Spectrum" <- w115
      }
    }
    Logical And($"Station Active", w119) -> w159
    case (w159) {
      frame False, Default { }
      frame True {
        $"Channel Estimation" <- w118
      }
    }
    $"TX Indication Overflow Count" <- w121
    Is Not Equal To 0(x=w121) -> w160
    $"TX Indication Overflow" <- w160
    $"RX Indication Overflow Count" <- w122
    Is Not Equal To 0(x=w122) -> w161
    $"RX Indication Overflow" <- w161
    $"Target FIFO Overflow" <- w125
    $"Compensated CFO [Hz]" <- w126
    $"RF Input Power" <- w127
    $"Baseband RX Power" <- w130
    $"packets sync output" <- w131
    Array Index(array=w130) -> (out0[0, 1]=w162)
    $"Baseband RX Power [dBFS]" <- w162
    Quotient And Remainder(x=i2, y=4) -> (x-y*floor(x/y)=w163)
    Is Equal To 0(x=w163) -> w164
    call "802.11 Prepare MAC TX and RX Statistics.gvi"(MAC RX statistics in=w128, MAC TX statistics in=w129, values per second=$"values per second", 1s passed=w164) -> (MAC RX statistics out=w165, MAC TX statistics out=w166)
    $"MAC RX statistics" <- w165
    $"MAC TX statistics" <- w166
    Build Array[ConcatenateInputs=True](s7, w149) -> w167
    Array Size(array=w167) -> (size(s)=w168)
    Is Greater(x=w168, y=w132) -> w169
    case (w169) {
      frame False, Default {
        w170 = w167
      }
      frame True {
        Decrement(x=w132) -> w171
        Delete From Array(inArray=w167, length (1)=w171) -> (deleted=w172)
        case (w137) {
          frame True {
            w170 = w172
          }
          frame False {
            Build Array[ConcatenateInputs=True]("(...)\n", w172) -> w170
          }
        }
      }
    }
    Select(s=$"Clear events", t=string[] [], f=w170) -> w173
    Concatenate Strings(w170) -> w174
    $Events <- w174
    Select(s=$None, t="802.11 Events Enable Mask.gtype" {all zero or empty}, f=$"FPGA events to track") -> w175
    w176 = "802.11 Events Enable Mask.gtype" {"PHY TX start request"=TRUE, "PHY TX end indication"=TRUE, "PHY RX start indication"=TRUE, "PHY RX end indication"=TRUE, "PHY CCA timing indication"=TRUE, "PHY RX gain change indication"=TRUE, "DCF state indication"=TRUE, "MAC MPDU RX indication"=TRUE, "MAC MPDU TX request"=TRUE}
    Select(s=$All, t=w176, f=w175) -> w177
    $"FPGA events to track" <- w177
    Wait(time to wait=250)
    next s6 = w155
    next s7 = w173
    next s8 = w151
    stop if w156
  }
  Is Not A Number Or Path Or Refnum(number=s8) -> w178
  # close file if the reference still exists
  case (w178) {
    frame True {
      w179 = s6
    }
    frame False {
      Close File(error in=s6, refnum=s8) -> (error out=w179)
    }
  }
  call "Stop On Error.gvi"(error in=w179) -> (error out=w180)
  s9 = w8  # shift register
  while {
    Feedback Node(input=$"Station Active") -> w181
    Is Not Equal(x=$"Station Active", y=w181) -> w182
    # update plots and indicators (fast)
    case ($"Station Active") {
      frame False, Default {
        w183 = s9
      }
      frame True {
        Property Node(instance in=$session) -> ("FPGA interface"=w184, "receive throughput queue"=w185)
        call "802.11 Prepare Throughput Measurements.gvi"(reset=w182, FPGA interface=w184, receive throughput queue=w185, error in=s9, timing granularity=100) -> (error out=w186, RX throughput=w187)
        Flush Queue(error in=w186, queue=w9) -> (error out=w183, remaining elements=w188)
        call "802.11 Prepare TX Block Error Rate Measurements.gvi"(TX Status and retransmission data=w188) -> (current TX block error rate=w189, current TX packet error rate=w190, averaged retransmissions per packet=w191, TX Error Rates=w192)
        $"current TX packet error rate" <- w190
        $"current TX block error rate" <- w189
        $"TX Error Rates" <- w192
        $"Averaged Retransmissions per Packet" <- w191
        $"Averaged Retransmissions p. Packet" <- w191
        $"RX Throughput [bits/s]" <- w187
        Divide(x=w187, y=1000000) -> w193
        $"RX Throughput" <- w193
      }
    }
    call "Check Stop.gvi"(error in=w183) -> (error out=w194, stop=w195)
    Wait(time to wait=100)
    next s9 = w194
    stop if w195
  }
  call "Stop On Error.gvi"(error in=s9) -> (error out=w196)
  s10 = w7  # shift register
  while {
    # configuration
    Feedback Node(input=$"Station Active") -> w197
    case ($"Station Active") {
      frame False, Default {
        w198 = s10
      }
      frame True {
        Is Not Equal(x=$"Station Active", y=w197) -> w199
        Property Node(instance in=$session) -> ("FPGA interface"=w200, instance out=w201)
        Select(s=$"RF loop back demo mode", t=0, f=$Backoff) -> w202
        To Double Precision Float(number=$"AGC target signal power [dBFS]") -> w203
        call "802.11 Configure Dynamic Parameters.gvi"(FPGA interface=w200, error in=s10, enable channel capture=$"enable channel capture", event enable mask=$"FPGA events to track", backoff=w202, AGC target signal power=w203, CCA energy detection threshold=$"CCA Energy Detection Threshold [dBm]", Threshold=$Threshold, signal transmission stop=$"signal transmission stop") -> (error out=w204, threshold signal=w205)
        call "802.11 FPGA AGC Control.gvi"(session=w201, error in=w204, AGC=$AGC, RX Port (USRP only)=$"RX RF Port", initialize=w199) -> (session dup=w206, error out=w207, force host AGC update=w208)
        call "802.11 Gain Control.gvi"(initialize=w199, RX Port (USRP only)=$"RX RF Port", session=w206, AGC=$AGC, error in=w207, Manual RX gain [dB]=$"Manual RX gain [dB]", force update=w208) -> (Applied RX Gain [dB]=w209, error out=w198)
        $"Applied RX Gain [dB]" <- w209
        $"threshold signal" <- w205
      }
    }
    Feedback Node(input=$"Enable Station") -> w210
    Logical Exclusive Or($"Enable Station", w210) -> w211
    case (w211) {
      frame False, Default {
        w212 = s10
      }
      frame True {
        case ($"Enable Station") {
          frame False, Default {
            Property Node(instance in=$session) -> ("UDP Receiver"=w213, "FPGA interface"=w214, instance out=w215)
            sequence {
              frame 0 {
                $"Station Active" <- FALSE
              }
            }
            Property Node(instance in=w214, "station active"=FALSE, error in=s10) -> (error out=w216, instance out=w217)
            call "802.11 Mute TX RF Frontend.gvi"(session=w215, error in=w216) -> (session dup=w218, error out=w219)
            call "802.11 Abort RF Streams.gvi"(session in=w218, error in=w219, abort tx streams=FALSE, abort rx streams=TRUE) -> (session out=w220, error out=w221)
            Property Node(instance in=w217, "produce silent samples"=TRUE, "RX data source"="BB Data From Host", error in=w221) -> (error out=w222)
            sequence {
              frame 0 {
                Wait(time to wait=100)
              }
            }
            call "802.11 Abort RF Streams.gvi"(session in=w220, error in=w222, abort tx streams=TRUE, abort rx streams=FALSE) -> (error out=w223)
            Udp Close(connection ID=w213, error in=w223) -> (error out=w224)
            call "Clear Errors.gvi"(specific error code to clear=1, error in=w224) -> (error out=w212)
          }
          frame True {
            w225 = $"Station Number"
            Is Equal(x=$"Data Source", y="External") -> w226
            case ($"RF loop back demo mode") {
              frame True {
                w227 = 1
                w228 = 1
                w229 = "RF Loopback"
                w230 = 0x5000
              }
              frame False {
                w227 = $dot11LongRetryLimit
                w228 = $dot11ShortRetryLimit
                w229 = "RF Multi Station"
                w230 = $dot11RTSThreshold
              }
            }
            Property Node(instance in=$session, "station number"=w225) -> (instance out=w231)
            call "802.11 FPGA Target Configuration.gvi"(session=w231, error in=s10) -> (error out=w232, session dup=w233, TX advance=w234)
            call "802.11 Reset Statistics.gvi"(session in=w233, error in=w232, reset RX statistics=TRUE, reset TX statistics=TRUE) -> (error out=w235, session dup=w236)
            call "802.11 Configure Static Parameters.gvi"(session in=w236, error in=w235, primary channel selector=$"Primary Channel Selector", operation mode=w229, TX advance=w234) -> (session dup=w237, error out=w238)
            call "802.11 Configure MAC Parameters.gvi"(session in=w237, error in=w238, MAC address=$"Device MAC Address", dot11LongRetryLimit=w227, dot11ShortRetryLimit=w228, control frame TX vector configuration=$"control frame TX vector configuration", dot11RTSThreshold=w230) -> (session dup=w239, error out=w240)
            call "802.11 Configure RF.gvi"(error in=w240, session=w239, TX Port=$"TX RF Port", RX port=$"RX RF Port", primary channel selector=$"Primary Channel Selector", TX power level=$"Power Level [dBm]", primary channel center frequency=$"Primary Channel Center Frequency [Hz]") -> (session dup=w241, error out=w242, coerced RX LO frequency=w243, coerced TX LO frequency=w244, coerced RX gain=w245, coerced TX power level=w246, RF center frequency=w247)
            call "802.11 Channelization Visualization.gvi"(session=w241, error in=w242, primary channel selector=$"Primary Channel Selector", primary channel center frequency=$"Primary Channel Center Frequency [Hz]") -> (session dup=w248, error out=w249, channelization=w250)
            call "802.11 Configure AGC Registers.gvi"(TX Port=$"TX RF Port", session=w248, RX port=$"RX RF Port", error in=w249) -> (error out=w251, session dup=w252)
            call "802.11 Set Power Calibration Offset.gvi"(session=w252, frequency=$"Primary Channel Center Frequency [Hz]", error in=w251, RX port=$"RX RF Port") -> (session dup=w253, error out=w254)
            call "802.11 Configure RF Streams.gvi"(TX port=$"TX RF Port", RX port=$"RX RF Port", session=w253, error in=w254) -> (session dup=w255, error out=w256)
            call "802.11 Configure Data Source.gvi"(error in=w256, external mode=w226, session in=w255) -> (error out=w212, session out=w257, success?=w258)
            sequence {
              frame 0 {
                $session <- w257
                call "802.11 UDP Port Assignment.gvi"(station number=w225, external mode=w226) -> (UDP data=w259, TX requests=w260, local TX confirmations=w261, local RX indications=w262, local TX indications=w263)
              }
              frame 1 {
                $"Enable Station" <- w258
                $"Station Active" <- w258
                $"Receive Port" <- w259
                $"TX requests" <- w260
                $"local TX confirmations" <- w261
                $"local TX indications" <- w263
                $"local RX indications" <- w262
              }
            }
            $Channelization <- w250
            $"Coerced Power Level [dBm]" <- w246
            $"Applied RX Gain [dB]" <- w245
            $"Coerced LO frequency TX [Hz]" <- w244
            $"Coerced LO frequency RX [Hz]" <- w243
            $"RF Frequency [Hz]" <- w247
          }
        }
      }
    }
    call "802.11 Reset Statistics.gvi"(session in=$session, error in=s10, reset RX statistics=$"reset RX staistics", reset TX statistics=$"reset TX staistics") -> (error out=w264)
    call "802.11 Subcarrier Format to Configuration.gvi"(MCS=$MCS, Subcarrier Format=$"Subcarrier Format", error in=w264) -> (modulation and coding rate=w265, error out=w266)
    call "802.11 MAC Address from String to Byte Array.gvi"(error in=w266, MAC address in=$"Device MAC Address") -> (error out=w267, MAC address valid=w268)
    call "802.11 MAC Address from String to Byte Array.gvi"(error in=w267, MAC address in=$"Destination MAC Address") -> (error out=w269, MAC address valid=w270)
    Merge Errors(w198, w212, w269) -> (error out=w271)
    # disable station in last loop run and assert stop
    Feedback Node(input=$Stop) -> w272
    call "Create Stop.gvi"(error in=w271, stop in=w272) -> (error out=w273)
    call "Check Stop.gvi"(error in=w273) -> (error out=w274, stop=w275)
    case ($Stop) {
      frame False, Default { }
      frame True {
        $"Enable Station" <- FALSE
      }
    }
    Wait Until Next Multiple(multiple to wait=100)
    $valid <- w268
    $valid <- w270
    $"modulation and coding rate" <- w265
    next s10 = w274
    stop if w275
  }
  call "Stop On Error.gvi"(error in=s10) -> (error out=w276)
  Merge Errors(w276, w62, w105, w34, w180, w196) -> (error out=w277)
  sequence {
    frame 0 {
      w278 = $session
    }
  }
  call "802.11 Host Release.gvi"(session=w278, error in=w277) -> (error out=w279)
  call "Simple Error Handler.gvi"(type of dialog="OK message", error in=w279)
